vi "ManchesterProject.gvi"   [LabVIEW NXG 5.1.0]
panel controls:
  "sender": path
panel indicators:
  "Origenal Signal": bool[]
  "Coded Signal": bool[]
  "Output": u8
  "output signal": bool[]
diagram:
  Open Or Create Or Replace File(file path (use dialog)=$sender) -> (error out=w1, refnum out=w2)
  Read From Binary File(error in=w1, file (use dialog)=w2) -> (data=w3, error out=w4, refnum out=w5)
  for {
    w6 = each element of w3
    Number To Boolean Array(number=w6) -> (Boolean array=w8)
    concatenate w8 onto w7
  }
  Reverse 1D Array(array=w7) -> (reversed array=w9)
  for {
    w10 = each element of w9
    Select(s=w10, t=[FALSE, TRUE], f=[TRUE, FALSE]) -> w13
    Build Array(w10, w10) -> w14
    concatenate w14 onto w11
    concatenate w13 onto w12
  }
  Array Subset(array=w12, index0=0, length0=100) -> w15
  $"Coded Signal" <- w15
  Decimate Array(array=w15) -> (out1=w16)
  Array Size(array=w16) -> (size(s)=w17)
  Divide(x=w17, y=8) -> w18
  for (N = w18) (iteration -> i1) {
    Multiply(i1, 8) -> w19
    Array Subset(array=w16, index0=w19, length0=8) -> w20
    $"output signal" <- w20
    Reverse 1D Array(array=w20) -> (reversed array=w21)
    Boolean Array To Number(Boolean array=w21) -> (number=w22)
    To Unsigned 8 Bit Integer(number=w22) -> w23
  }
  $Output <- w23
  Close File(error in=w4, refnum=w5)
  Array Subset(array=w11, index0=0, length0=100) -> w24
  $"Origenal Signal" <- w24
